# Grasshopper definition 3Dpyrography_interface.gh (Grasshopper 1.0.7)
# plug-ins: Human UI, Human, MetaHopper, Droid, LunchBox

create_button = CreateButton(ButtonName="Reset Color", ButtonStyle=3)
create_button_2 = CreateButton(ButtonName="Save Gcode", ButtonStyle=3)
adjust_element_appearance = AdjustElementAppearance(
    ElementsToAdjust=[create_button, create_button_2],
    Foreground=ColourSwatch(SwatchColor=RGB(219, 219, 219)),
    Background=ColourSwatch(SwatchColor=RGB(76, 76, 76)),
    FontSize=Slider(13, range=0..100))
create_label = CreateLabel(LabelSize=12, Justification=0)
create_label_2 = CreateLabel(LabelSize=12, Justification=0)
create_label_3 = CreateLabel(LabelText="Printer Settings", LabelSize=Slider(13, range=0..100), Justification=0)
adjust_element_positioning = AdjustElementPositioning(ElementsToAdjust=[create_button, create_button_2], AbsolutePositioning=False, Width=Slider(150, range=0..1000))

# ----
# color button files
file_path = FilePath(["C:\Users\justin\Dropbox\My PC (DESKTOP-O1MDCKQ)\Documents\GIT\3DPyrography\Rhino\gui_colors\1.png", "C:\Users\justin\Dropbox\My PC (DESKTOP-O1MDCKQ)\Documents\GIT\3DPyrography\Rhino\gui_colors\2.png", "C:\Users\justin\Dropbox\My PC (DESKTOP-O1MDCKQ)\Documents\GIT\3DPyrography\Rhino\gui_colors\3.png", "C:\Users\justin\Dropbox\My PC (DESKTOP-O1MDCKQ)\Documents\GIT\3DPyrography\Rhino\gui_colors\4.png", "C:\Users\justin\Dropbox\My PC (DESKTOP-O1MDCKQ)\Documents\GIT\3DPyrography\Rhino\gui_colors\5.png", "C:\Users\justin\Dropbox\My PC (DESKTOP-O1MDCKQ)\Documents\GIT\3DPyrography\Rhino\gui_colors\6.png", "C:\Users\justin\Dropbox\My PC (DESKTOP-O1MDCKQ)\Documents\GIT\3DPyrography\Rhino\gui_colors\7.png", "C:\Users\justin\Dropbox\My PC (DESKTOP-O1MDCKQ)\Documents\GIT\3DPyrography\Rhino\gui_colors\8.png", "C:\Users\justin\Dropbox\My PC (DESKTOP-O1MDCKQ)\Documents\GIT\3DPyrography\Rhino\gui_colors\9.png", "C:\Users\justin\Dropbox\My PC (DESKTOP-O1MDCKQ)\Documents\GIT\3DPyrography\Rhino\gui_colors\10.png", "C:\Users\justin\Dropbox\My PC (DESKTOP-O1MDCKQ)\Documents\GIT\3DPyrography\Rhino\gui_colors\11.png", "C:\Users\justin\Dropbox\My PC (DESKTOP-O1MDCKQ)\Documents\GIT\3DPyrography\Rhino\gui_colors\12.png", "C:\Users\justin\Dropbox\My PC (DESKTOP-O1MDCKQ)\Documents\GIT\3DPyrography\Rhino\gui_colors\13.png", "C:\Users\justin\Dropbox\My PC (DESKTOP-O1MDCKQ)\Documents\GIT\3DPyrography\Rhino\gui_colors\14.png", "C:\Users\justin\Dropbox\My PC (DESKTOP-O1MDCKQ)\Documents\GIT\3DPyrography\Rhino\gui_colors\15.png", "C:\Users\justin\Dropbox\My PC (DESKTOP-O1MDCKQ)\Documents\GIT\3DPyrography\Rhino\gui_colors\16.png"])

file_path_2 = FilePath(["C:\Users\justin\Dropbox\My PC (DESKTOP-O1MDCKQ)\Documents\GIT\3DPyrography\Rhino\gui_colors\g1.png", "C:\Users\justin\Dropbox\My PC (DESKTOP-O1MDCKQ)\Documents\GIT\3DPyrography\Rhino\gui_colors\g2.png", "C:\Users\justin\Dropbox\My PC (DESKTOP-O1MDCKQ)\Documents\GIT\3DPyrography\Rhino\gui_colors\g3.png", "C:\Users\justin\Dropbox\My PC (DESKTOP-O1MDCKQ)\Documents\GIT\3DPyrography\Rhino\gui_colors\g4.png"])
create_label_4 = CreateLabel(LabelText="Gradient", LabelSize=12, Justification=0)
create_label_5 = CreateLabel(LabelSize=12, Justification=0)
create_label_6 = CreateLabel(LabelText="Discrete", LabelSize=12, Justification=0)
adjust_element_positioning_2 = AdjustElementPositioning(
    ElementsToAdjust=[create_label_6, create_label_4],
    AbsolutePositioning=False,
    Width=Slider(119, range=0..1000),
    HorizontalAlignment=2)

panel = Panel("""1) Pick a color on the left and select geometries

2) Press Reset Color button to redo coloring

3) Click Edit Mode to Print Mode to visualize Gcode Paths

4) Press Save Gcode button to save the Gcode file""")
create_text_block = CreateTextBlock(Text=panel, TextSize=12, Justification=0)
create_label_7 = CreateLabel(LabelText="Description", LabelSize=12, Justification=0)
create_label_8 = CreateLabel(LabelSize=12, Justification=0)

create_checkbox = CreateCheckbox(Label="zHop", StartingValue=True)
create_checkbox_2 = CreateCheckbox(Label="retraction", StartingValue=True)
create_text_box = CreateTextBox(Label="speed", DefaultText="100", UpdateButton=False, showLabel=True)
create_label_9 = CreateLabel(LabelSize=12, Justification=0)
create_text_box_2 = CreateTextBox(Label="infill", DefaultText="7", UpdateButton=False, showLabel=True)
create_text_box_3 = CreateTextBox(Label="Mult.(x)", DefaultText="1.5", UpdateButton=False, showLabel=True)
create_text_box_4 = CreateTextBox(Label="L height", DefaultText="0.4", UpdateButton=False, showLabel=True)
create_toggle = CreateToggle(Default=False, OnLabel="Print Mode", OffLabel="Edit Mode")

launch_transparent_window = LaunchTransparentWindow(
    Show=Toggle(True),
    Name="3D Pyrography",
    Width=Slider(350, range=0..3000),
    Height=Slider(910, range=0..1500),
    ChildStatus=0,
    EnableHorizScroll=False)
colour_swatch = ColourSwatch(SwatchColor=RGBA(255, 255, 255, 67))
set_window_properties = SetWindowProperties(
    Window=launch_transparent_window,
    Theme=0,
    ShowTitleBar=True,
    BackgroundColor=colour_swatch,
    ScaleFactor=Slider(1, range=0..1))

number_slider = Slider(100, range=0..1000)
adjust_element_positioning_3 = AdjustElementPositioning(
    ElementsToAdjust=create_button,
    Margin="0,7,0,0",
    AbsolutePositioning=False,
    Width=Slider(90, range=0..1000),
    Height=Slider(0, range=0..1000),
    HorizontalAlignment=0,
    VerticalAlignment=2)
adjust_element_positioning_4 = AdjustElementPositioning(
    ElementsToAdjust=create_button_2,
    Margin="0,3,0,0",
    AbsolutePositioning=False,
    Width=Slider(90, range=0..1000),
    Height=Slider(5, range=0..1000),
    HorizontalAlignment=0,
    VerticalAlignment=2)

adjust_element_positioning_5 = AdjustElementPositioning(
    ElementsToAdjust=create_label_7,
    Margin=Slider(0, range=0..100),
    AbsolutePositioning=False,
    Width=Slider(98, range=0..1000),
    HorizontalAlignment=0,
    VerticalAlignment=2)
adjust_element_appearance_2 = AdjustElementAppearance(ElementsToAdjust=create_label_7, FontSize=Slider(15, range=0..100))
colour_swatch_2 = ColourSwatch(SwatchColor=RGB(0, 0, 0))
adjust_element_appearance_3 = AdjustElementAppearance(ElementsToAdjust=create_text_block, Foreground=colour_swatch_2, Background=colour_swatch)
adjust_element_positioning_6 = AdjustElementPositioning(ElementsToAdjust=create_text_block, AbsolutePositioning=False, Width=Slider(150, range=0..1000), HorizontalAlignment=0)

adjust_element_appearance_4 = AdjustElementAppearance(
    ElementsToAdjust=[create_label_6, create_label_4],
    Foreground=colour_swatch_2,
    Background=colour_swatch,
    FontSize=Slider(15, range=0..100))

number_slider_2 = Slider(149, range=0..1000)
adjust_element_positioning_7 = AdjustElementPositioning(
    ElementsToAdjust=create_checkbox_2,
    Margin="0,3,0,0",
    AbsolutePositioning=False,
    Width=number_slider_2,
    HorizontalAlignment=0)
adjust_element_positioning_8 = AdjustElementPositioning(
    ElementsToAdjust=create_text_box_3,
    Margin="0,3,0,0",
    AbsolutePositioning=False,
    Width=number_slider_2,
    HorizontalAlignment=0)
adjust_element_positioning_9 = AdjustElementPositioning(
    ElementsToAdjust=create_text_box_2,
    Margin="0,3,0,0",
    AbsolutePositioning=False,
    Width=number_slider_2,
    HorizontalAlignment=0)
adjust_element_positioning_10 = AdjustElementPositioning(
    ElementsToAdjust=create_checkbox,
    Margin="0,3,0,0",
    AbsolutePositioning=False,
    Width=number_slider_2,
    HorizontalAlignment=0)
adjust_element_positioning_11 = AdjustElementPositioning(
    ElementsToAdjust=create_text_box_4,
    Margin="0,3,0,0",
    AbsolutePositioning=False,
    Width=number_slider_2,
    HorizontalAlignment=0)
adjust_element_positioning_12 = AdjustElementPositioning(
    ElementsToAdjust=create_text_box,
    Margin="0,3,0,0",
    AbsolutePositioning=False,
    Width=number_slider_2,
    HorizontalAlignment=0)

colour_swatch_3 = ColourSwatch(SwatchColor=RGBA(148, 115, 70, 254))
colour_swatch_4 = ColourSwatch(SwatchColor=RGBA(145, 109, 65, 252))
colour_swatch_5 = ColourSwatch(SwatchColor=RGBA(158, 125, 77, 254))
colour_swatch_6 = ColourSwatch(SwatchColor=RGBA(181, 154, 112, 253))
colour_swatch_7 = ColourSwatch(SwatchColor=RGBA(181, 149, 105, 254))
colour_swatch_8 = ColourSwatch(SwatchColor=RGBA(173, 142, 95, 254))
colour_swatch_9 = ColourSwatch(SwatchColor=RGBA(194, 167, 124, 254))
colour_swatch_10 = ColourSwatch(SwatchColor=RGBA(186, 159, 119, 254))
colour_swatch_11 = ColourSwatch(SwatchColor=RGBA(166, 132, 85, 254))
merge = Merge(
    Data1=colour_swatch_9,
    Data2=colour_swatch_10,
    Data3=colour_swatch_6,
    Data4=colour_swatch_7,
    Data5=colour_swatch_8,
    Data6=colour_swatch_11,
    Data7=colour_swatch_5,
    Data8=colour_swatch_3,
    Data9=colour_swatch_4,
    Data10=ColourSwatch(SwatchColor=RGBA(130, 97, 57, 254)),
    Data11=ColourSwatch(SwatchColor=RGBA(115, 82, 45, 254)),
    Data12=ColourSwatch(SwatchColor=RGBA(107, 77, 42, 252)),
    Data13=ColourSwatch(SwatchColor=RGBA(102, 71, 40, 252)),
    Data14=ColourSwatch(SwatchColor=RGBA(97, 66, 35, 252)),
    Data15=ColourSwatch(SwatchColor=RGBA(89, 59, 33, 252)),
    Data16=ColourSwatch(SwatchColor=RGBA(79, 55, 31, 252)),
    Data17=ColourSwatch(SwatchColor=RGBA(255, 0, 0, 32)),
    Data18=ColourSwatch(SwatchColor=RGBA(0, 21, 255, 73)),
    Data19=ColourSwatch(SwatchColor=RGBA(0, 255, 8, 126)),
    Data20=ColourSwatch(SwatchColor=RGBA(255, 255, 0, 170)))  # -> simplify(graft(Result))
merge_2 = Merge(
    Data1=colour_swatch_9,
    Data2=colour_swatch_10,
    Data3=colour_swatch_6,
    Data4=colour_swatch_7,
    Data5=colour_swatch_8,
    Data6=colour_swatch_11,
    Data7=colour_swatch_5,
    Data8=colour_swatch_3,
    Data9=colour_swatch_4)  # -> simplify(flatten(Result))
h_gradient_count = Slider(10, range=0..10)

# ----
# when using your own filament,
full_temp_list = Panel("""195
205
210
225
230
235
240
245
250
260
270
275
280
285
290
300""")
full_color_list = Panel("""40
50
60
70
80
100
115
120
140
160
180
200
220
230
250
255""")
c_script = CSharpScript(full_colorList=full_color_list, temperatureList=full_temp_list)  # -> out, Mapped; inputs grayscale: list of Double, full_colorList: list of Double, temperatureList: list of Double
# ---------- c_script: C# ----------
    Dictionary<double, double> colorValues = new Dictionary<double, double>();
    List<double> applied_colors = new List<double>();
    for(int i = 0 ; i < full_colorList.Count; i++)
    {
      colorValues.Add(full_colorList[i], temperatureList[i]);
    }
    
    for(int i = 0; i < grayscale.Count;i++)
    {
      double c = colorValues[grayscale[i]];
      applied_colors.Add(c);
    }
    Mapped = applied_colors;
# ---------- end c_script ----------

defaulttemp = Number("100")
number_slider_3 = Slider(201, range=0..359)  # disabled
polyline = PolyLine(Closed=False)

y_build_plate = Panel("200")
z_build_plate = Panel("300")
x_build_plate = Panel("300")
domain_box = DomainBox(Base=PlaneXY(0, 0, 0), X=x_build_plate, Y=y_build_plate, Z=z_build_plate)
brep_wireframe = BrepWireframe(Brep=domain_box, Density=-1)

number_slider_4 = Slider(10, range=0..10)
data = Data()

retraction = BooleanToggle(True)
zlift = BooleanToggle(True)

# ----
# Header Gcode
panel_2 = Panel("""G90
M82
M106 S0
G10 P1 S195 R0 ; set active and standby temperature
M190 S50
T1""")

# ----
# Footer Gcode
panel_3 = Panel("""T-1 ; dock the active tool

G1 X5 Y5 F20000 ; parking toolchanger

G10 P0 S0 R0 ; set active and standby temperature
G10 P1 S0 R0 ; set active and standby temperature
G10 P2 S0 R0 ; set active and standby temperature
G10 P3 S0 R0 ; set active and standby temperature

M0 ; turn off all heater
M84 ; disable motors""")

create_rhino_pick_button = CreateRhinoPickButton(ImagePath=file_path_2, Prompt="Please select geometry...", AllowMultiple=True, AllowNone=True, Type=0, ButtonStyle=3)

adjust_element_positioning_13 = AdjustElementPositioning(
    ElementsToAdjust=create_rhino_pick_button,
    AbsolutePositioning=False,
    Width=Slider(96, range=0..1000),
    Height=Slider(30, range=0..1000))
adjust_element_appearance_5 = AdjustElementAppearance(ElementsToAdjust=create_rhino_pick_button, Background=ColourSwatch(SwatchColor=RGB(255, 255, 255)))

create_rhino_pick_button_2 = CreateRhinoPickButton(ImagePath=file_path, Prompt="Please select geometry...", AllowMultiple=True, AllowNone=True, Type=0, ButtonStyle=3)

adjust_element_positioning_14 = AdjustElementPositioning(
    ElementsToAdjust=create_rhino_pick_button_2,
    AbsolutePositioning=False,
    Width=Slider(96, range=0..1000),
    Height=Slider(30, range=0..1000))
merge_3 = Merge(Data1=create_rhino_pick_button_2, Data2=create_rhino_pick_button)
value_listener = ValueListener(Elements=merge_3, SomeProperty=True)  # -> Values, Indices

merge_4 = Merge(
    Data1=create_label_6,
    Data2=create_rhino_pick_button_2,
    Data3=create_label_5,
    Data4=create_label_4,
    Data5=create_rhino_pick_button)
merge_5 = Merge(
    Data1=create_label_7,
    Data2=create_text_block,
    Data3=create_label_8,
    Data4=create_label,
    Data7=create_label_3,
    Data8=create_checkbox_2,
    Data9=create_checkbox,
    Data11=create_label_9,
    Data13=create_text_box_3,
    Data14=create_text_box_4,
    Data15=create_text_box_2,
    Data16=create_text_box,
    Data23=create_toggle,
    Data26=create_button,
    Data27=create_button_2)
create_stack = CreateStack(UIElements=flatten(merge_4), Horizontal=False)
create_stack_2 = CreateStack(UIElements=flatten(merge_5), Horizontal=False)

merge_6 = Merge(Data1=create_stack, Data2=create_stack_2)  # -> simplify(Result)

adjust_element_positioning_15 = AdjustElementPositioning(
    ElementsToAdjust=create_stack,
    Margin=Slider(0, range=0..100),
    AbsolutePositioning=False,
    Width=Slider(166, range=0..1000),
    Height=Slider(950, range=0..1000),
    HorizontalAlignment=2,
    VerticalAlignment=2)
adjust_element_positioning_16 = AdjustElementPositioning(
    ElementsToAdjust=create_stack_2,
    Margin=Slider(0, range=0..100),
    AbsolutePositioning=False,
    Width=Slider(170, range=0..1000),
    Height=Slider(950, range=0..1000),
    HorizontalAlignment=0,
    VerticalAlignment=2)

panel_4 = Panel("""1
1""")
partition_list = PartitionList(List=flatten(merge_6), Size=panel_4)  # -> simplify(Chunks)

create_simple_grid = CreateSimpleGrid(
    UIElements=partition_list,
    Width=Slider(300, range=0..300),
    Height=Slider(850, range=0..2000),
    RowDefinitions="Auto",
    ColumnDefinitions="2*")

add_elements = AddElements(Window=launch_transparent_window, Elements=flatten(create_simple_grid), DoVLChecking=True)  # -> AddedElements, ElementNames
adjust_element_appearance_6 = AdjustElementAppearance(ElementsToAdjust=create_rhino_pick_button_2, Background=ColourSwatch(SwatchColor=RGB(255, 255, 255)))
brep = Brep(value_listener.Values)
tree_statistics = TreeStatistics(Tree=brep)  # -> Paths, Length, Count
tree_branch = TreeBranch(Tree=merge, Path=tree_statistics.Paths, MaintainPaths=True)
c_script_2 = CSharpScript(x=tree_branch)  # -> out, A; inputs x: tree of Color
# ---------- c_script_2: C# ----------
    for(int i = 0 ; i < x.BranchCount;i++)
    {
      for(int j = 0 ; j < x.Branch(i).Count;j++)
      {

        if(x.Branch(i)[j].A < 200)
        {
          //          Color c = Color.FromArgb(0, x.Branch(i)[j].R, x.Branch(i)[j].G, x.Branch(i)[j].B);
          Color c = Color.FromArgb(0, 0, 0, 0); // turn in to white transparent

          x.Branch(i)[j] = c;
        }
      }
    }
    A = x;
# ---------- end c_script_2 ----------
createattributes = CreateAttributes(Color=c_script_2.A, enableFullPath=True)  # -> simplify(ObjectAttributes)
modify_object_attributes = ModifyObjectAttributes(Objects=brep, Attributes=createattributes)
brep_join = BrepJoin(Breps=brep)  # -> Breps, Closed
brep_2 = Brep(brep_join.Breps)
getcolorfrombrep = GetColorFromBrep(brep=brep_2, colordata=tree_branch)  # -> geo_2, color_2, data_2
mapcolor2temp = MapColor2Temp(grayscale=getcolorfrombrep.color_2, mintemp="300", maxtemp="195")  # -> mapped, mintemp_3, maxtemp_3
brep_3 = Brep(flatten(brep_2))
brep_join_2 = BrepJoin(Breps=brep_3)  # -> Breps, Closed
data_2 = Data(mapcolor2temp.mapped)

create_markdown_viewer = CreateMarkdownViewer(Text=panel)
value_listener_2 = ValueListener(Elements=create_checkbox, SomeProperty=True)  # -> Values, Indices
value_listener_3 = ValueListener(Elements=create_button_2, SomeProperty=True)  # -> Values, Indices
value_listener_4 = ValueListener(Elements=create_button, SomeProperty=True)  # -> Values, Indices
value_listener_5 = ValueListener(Elements=create_toggle, SomeProperty=True)  # -> Values, Indices
value_listener_6 = ValueListener(Elements=create_checkbox_2, SomeProperty=True)  # -> Values, Indices
value_listener_7 = ValueListener(Elements=create_text_box, SomeProperty=True)  # -> Values, Indices
value_listener_8 = ValueListener(Elements=create_text_box_2, SomeProperty=True)  # -> Values, Indices
value_listener_9 = ValueListener(Elements=create_text_box_3, SomeProperty=True)  # -> Values, Indices
value_listener_10 = ValueListener(Elements=create_text_box_4, SomeProperty=True)  # -> Values, Indices
resetcolor = CSharpScript(x=value_listener_4.Values)  # -> out, A; inputs x: Boolean
# ---------- resetcolor: C# usings ----------
using Rhino.DocObjects;
# ---------- resetcolor: C# ----------
    if(x){

      RhinoDoc doc = RhinoDoc.ActiveDoc;

      // Get all objects in the document
      var objects = doc.Objects.GetObjectList(ObjectType.AnyObject);

      // Change the display color of all objects to their respective layer color
      foreach (var obj in objects)
      {
        var layer = doc.Layers.FindIndex(obj.Attributes.LayerIndex);
        if (layer != null)
        {
          obj.Attributes.ObjectColor = layer.Color;
          obj.CommitChanges();
        }
      }

      // Redraw the active Rhino view
      doc.Views.Redraw();

      A = "Display colors changed to layer color.";
    }
# ---------- end resetcolor ----------
number = Number(value_listener_9.Values)
number_2 = Number(value_listener_10.Values)
number_3 = Number(value_listener_8.Values)
outerwallprintspeed = Number(value_listener_7.Values)
hide_show = CSharpScript(mode=value_listener_5.Values)  # inputs mode: Boolean
# ---------- hide_show: C# usings ----------
using Rhino.DocObjects;

using Rhino.Input;
# ---------- hide_show: C# ----------
    if(mode)
    {
      RhinoApp.RunScript("SelAll", false);
      RhinoApp.RunScript("Hide", false);
    }
    else
    {
      RhinoApp.RunScript("SelAll", false);
      RhinoApp.RunScript("Show", false);
    }
# ---------- end hide_show ----------

clear_out_data = CSharpScript(reset=value_listener_4.Values)  # -> A; inputs reset: Boolean
# ---------- clear_out_data: C# usings ----------
using Grasshopper.Kernel.Special;
using System.Linq;
# ---------- clear_out_data: C# ----------
    var drs = FindInCurrentGroup();
    if(reset) {
      drs[0].ClearData();

      drs[0].ExpireSolution(true);
    }
    A = drs;
# ---------- clear_out_data: C# additional code ----------
  private List<GH_Component> FindInCurrentGroup()
  {
    var groups = GrasshopperDocument.Objects.OfType<GH_Group>().Where(gr => gr.ObjectIDs.Contains(Component.InstanceGuid)).ToList();
    var output = groups.Aggregate(new List<GH_Component>(), (list, item) =>
      {
      list.AddRange(
        GrasshopperDocument.Objects.OfType<GH_Component>()
        .Where(obj => item.ObjectIDs.Contains(obj.InstanceGuid))
        );
      return list;
      }).Distinct().ToList();
    return output;
  }
# ---------- end clear_out_data ----------

clear_out_data_2 = CSharpScript(reset=value_listener_4.Values)  # -> A; inputs reset: Boolean; same code as clear_out_data

cluster = Cluster(data=brep, number=Slider(0.05, range=0..1), number_2=h_gradient_count)  # -> colour_2, contours_2, colour, contours, colour_4, segments_2, colour_3, segments
gate_not = GateNot(A=value_listener_5.Values)
custom_preview = CustomPreview(Geometry=cluster.segments, Material=cluster.colour_3)
hide_show_object_preview = HideShowObjectPreview(Visible=gate_not)
custom_preview_2 = CustomPreview(Geometry=cluster.segments_2, Material=reverse(cluster.colour_4))
custom_preview_3 = CustomPreview(Geometry=flatten(cluster.contours), Material=cluster.colour)
custom_preview_4 = CustomPreview(Geometry=flatten(cluster.contours_2), Material=reverse(cluster.colour_2))

enable_disable_object = EnableDisableObject(Enabled=value_listener_5.Values, AllObjects_Object=brep_2)
getcontour = GetContour(shape=getcolorfrombrep.geo_2, layer_height=number_2)
getinnerwall = GetInnerWall(brep=brep_join_2.Breps, distance=number_2, linegapmultiplier=number)  # -> innerwalls, infill_ref
settemp_gradientv = CSharpScript(
    segmentCrv=getcontour,
    temp=data_2,
    FeedRate=outerwallprintspeed,
    defaultTemp=defaulttemp,
    colorType=getcolorfrombrep.data_2,
    minTemp=mapcolor2temp.mintemp_3,
    maxTemp=mapcolor2temp.maxtemp_3)  # -> out, pathData, tempData, path, A, B, C; inputs segmentCrv: tree of Polyline, temp: list of Int32, FeedRate: Int32, defaultTemp: Int32, colorType: list of String, minTemp: Int32, maxTemp: Int32
# ---------- settemp_gradientv: C# usings ----------
using System.Linq;
# ---------- settemp_gradientv: C# ----------
    DataTree<string> pathInfo = new DataTree<string>();
    DataTree<double> tempInfo = new DataTree<double>();

    DataTree<Polyline> pathHorizontalGradient = new DataTree<Polyline>();
    DataTree<string> infoHorizontalGradient = new DataTree<string>();
    DataTree<double> tempHorizontalGradient = new DataTree<double>();

    for(int i = 0 ; i < segmentCrv.BranchCount;i++) // contour lines for each surfaces
    {
      GH_Path branch = new GH_Path(i);
      string cType = colorType[i][0].ToString();
      int cDir = int.Parse(colorType[i][1].ToString());
      //      Print(cDir.ToString());

      for(int j = 0 ; j < segmentCrv.Branch(i).Count;j++) // line segment
      {
        int temperature = (int) Math.Round((double) temp[i], 1);
        double printSpeed = 0.0;
        if(temperature < 210){printSpeed = 1500;}
        else{printSpeed = (double) FeedRate;}




        if(cType == "V")
        {
          if(Convert.ToBoolean(cDir)){temperature = mapTemp(j, 0, (segmentCrv.Branch(i).Count - 1), minTemp, maxTemp);}
          else{temperature = mapTemp(j, 0, (segmentCrv.Branch(i).Count - 1), maxTemp, minTemp);}

          string data = String.Format("T{0} F{1} C{2}", temperature, printSpeed, cType);
          pathInfo.Add(data, branch);
          tempInfo.Add(temperature, branch);
        }
        else if(cType == "H")
        {
          bool reversed = false;
          if(!Convert.ToBoolean(cDir)){reversed = true;}

          Print(cDir.ToString());

          Print(reversed.ToString());


          PolylineCurve pCurve = segmentCrv.Branch(i)[j].ToPolylineCurve();
          Point3d[] pCurvePoints;
          double crvLength = segmentCrv.Branch(i)[j].Length;
          double segmentLength = crvLength;
          int segmentCount = 1;
          if(crvLength > 45){segmentCount = 22;}
          else if(crvLength > 30){segmentCount = 15;}
          else if(crvLength > 20){segmentCount = 10;Print("hh");}
          else if(crvLength > 12){segmentCount = 6;}
          else if(crvLength > 8){segmentCount = 4;}
          else if(crvLength > 3){segmentCount = 2;}
          segmentLength = crvLength / segmentCount;
          Double[] splitParameters = pCurve.DivideByLength(segmentLength, true, reversed, out pCurvePoints);
          Curve[] splitArrayCurve = pCurve.Split(splitParameters);
          Polyline[] splitPolyline = new Polyline[segmentCount];
          int[] splitTemp = new int[segmentCount];
          string[] gradientColorType = new string[segmentCount];

          for(int k = 0 ; k < segmentCount;k++)
          {
            if(reversed){temperature = mapTemp((k + 1) * segmentLength, segmentLength * 0.99, crvLength, maxTemp, minTemp);}
            else{temperature = mapTemp((k + 1) * segmentLength, segmentLength * 0.99, crvLength, minTemp, maxTemp);}
            pathHorizontalGradient.Add(splitArrayCurve[k].ToPolyline(0.1, 0.1, 1.0, segmentLength).ToPolyline(), branch);

            string data = String.Format("T{0} F{1} C{2}", temperature, printSpeed, cType);
            infoHorizontalGradient.Add(data, branch);
            tempHorizontalGradient.Add(temperature, branch);
          }

        }
        else
        {
          string data = String.Format("T{0} F{1} C{2}", temperature, printSpeed, cType);
          pathInfo.Add(data, branch);
          tempInfo.Add(temperature, branch);
        }
      }
    }
    A = tempHorizontalGradient;
    B = infoHorizontalGradient;
    C = pathHorizontalGradient;

    for(int p = 0;p < pathHorizontalGradient.Paths.Count;p++)
    {
      GH_Path index = pathHorizontalGradient.Paths.ToArray()[p];
      segmentCrv.RemovePath(index);
    }
    segmentCrv.MergeTree(pathHorizontalGradient);
    path = segmentCrv;

    tempInfo.MergeTree(tempHorizontalGradient);
    pathInfo.MergeTree(infoHorizontalGradient);
    tempData = tempInfo;
    pathData = pathInfo;
# ---------- settemp_gradientv: C# additional code ----------
  int mapTemp(double val, double x0, double x1, int y0, int y1)
  {
    return (int) Convert.ToInt32(y0 + (val - x0) * (y1 - y0) / (x1 - x0));
  }
# ---------- end settemp_gradientv ----------
tree_branch_2 = TreeBranch(Tree=settemp_gradientv.path, Path=Slider(7, range=0..16), MaintainPaths=True)
curve_to_polyline = CurveToPolyline(Curve=getinnerwall.innerwalls, ToleranceDistance=Slider(0.175, range=0..1), ToleranceAngle=0)  # -> Polyline, Segments
getinfill = GetInfill(
    linegapmultiplier=number,
    gradientangle=number_slider_3,
    pathdata=getinnerwall.infill_ref,
    geo=brep_join_2.Breps,
    distnace=number_3)  # -> top, result
sortpath2data = SortPath2Data(pathcrv=settemp_gradientv.path, pathdata=settemp_gradientv.pathData, tempdata=settemp_gradientv.tempData)  # -> sortedpath_2, sorteddata_2, sortedtemp_2
panel_5 = Panel(curve_to_polyline.Polyline)
list_length = ListLength(List=getinfill.top)
curve = Curve(getinfill.top)
infill = Data(getinfill.result)
curve_2 = Curve(getinfill.result)
stack_data = StackData(Data="T200 F500 CS", Stack=list_length)
feedratemultiplier = Number(number)
combiningprintingorder = CSharpScript(
    outerWall=sortpath2data.sortedpath_2,
    innerWall=curve_to_polyline.Polyline,
    infill=infill,
    outerWallData=sortpath2data.sorteddata_2,
    defaultTemp="195",
    defaultFeedRate="1500")  # -> out, printingPath, pathData; inputs gradientInfo: list of String, gradientCrv: list of Polyline, outerWall: tree of Polyline, innerWall: tree of Polyline, infill: tree of Polyline, outerWallData: tree of String, defaultTemp: Double
# ---------- combiningprintingorder: C# ----------
    DataTree<Polyline> path = new DataTree<Polyline>();
    DataTree<string> pathInfo = new DataTree<string>();
    string defaultPathData = String.Format("T{0} F{1} CS", defaultTemp, defaultFeedRate);
    // first check whether all input data has same layer count
    Print(outerWall.BranchCount.ToString());
    Print(innerWall.BranchCount.ToString());


    for(int i = 0 ; i < outerWall.BranchCount;i++)// printing path order for every layer
    {
      // new branch for each layer
      GH_Path layer = new GH_Path(i);

      // infill
      if( i < infill.BranchCount)
      {
        for( int j = 0 ; j < infill.Branch(i).Count; j++)
        {
          path.Add(infill.Branch(i)[j], layer); // the printing line
          pathInfo.Add(defaultPathData, layer); //  temp and speed data
        }
      }

      // inner wall
      if( i < innerWall.BranchCount)
      {
        for(int j = 0 ; j < innerWall.Branch(i).Count; j++)
        {
          path.Add(innerWall.Branch(i)[j], layer); // the printing line
          pathInfo.Add(defaultPathData, layer); //  temp and speed data
        }
      }

      // outer wall
      for(int k = 0;k < outerWall.Branch(i).Count;k++)
      {
        path.Add(outerWall.Branch(i)[k], layer); // the printing line
        pathInfo.Add(outerWallData.Branch(i)[k], layer); //  temp and speed data
      }
    }


    int branchCount = path.BranchCount; // get the latest branchCount
    GH_Path gradientLayer = new GH_Path(branchCount);

    // if gradient on top surface
    for(int i = 0; i < gradientCrv.Count; i++)
    {
      path.Add(gradientCrv[i], gradientLayer); // the printing line
      pathInfo.Add(gradientInfo[i], gradientLayer); //  temp and speed data


    }


    printingPath = path;
    pathData = pathInfo;
# ---------- combiningprintingorder: C# additional code ----------
  /// <summary>
  /// This method will be called once every solution, before any calls to RunScript.
  /// </summary>
  public override void BeforeRunScript()
  { }
  /// <summary>
  /// This method will be called once every solution, after any calls to RunScript.
  /// </summary>
  public override void AfterRunScript()
  { }
# ---------- end combiningprintingorder ----------
tree_branch_3 = TreeBranch(Tree=combiningprintingorder.printingPath, Path=Slider(251, range=0..2000), MaintainPaths=True)
panel_6 = Panel(stack_data)
panel_7 = Panel(sortpath2data.sorteddata_2)
printingpath2gcode = CSharpScript(
    path=combiningprintingorder.printingPath,
    pathInfo=combiningprintingorder.pathData,
    retraction=value_listener_6.Values,
    zLift=value_listener_2.Values,
    multiplier=feedratemultiplier)  # -> simplify(out), gCodeBody; inputs path: tree of Polyline, pathInfo: tree of String, retraction: Boolean, zLift: Boolean, multiplier: Double
# ---------- printingpath2gcode: C# ----------
    //    double x = 1.6;// x = multiplier
    double x = multiplier;// x = multiplier

    double h = 0.4;// h = laye height
    double dF = 1.75;// dF = filament diameter
    double dN = 0.8;// dN = nozzle diameter
    double travelSpeed = 10000; // mm/min
    double retractionSpeed = 400;// mm/min
    double retractionDistance = 0.05;
    double zLiftSpeed = 1500;// mm/min
    double zLiftDistance = 3.000;
    int coordRoundDecimal = 3;
    int extrusionRoundDecimal = 5;
    int tool = 1; //tool number
    double prevTemp = 0;
    double endpointZ = 0;
    bool fan = false;
    int minTemp = 195;
    int gradientStart = 240;
    int gradientEnd = 300;

    List<string> gCode = new List<string>(); // output of this node

    // generate gCode
    for(int i = 0 ; i < path.BranchCount;i++) // layer branch
    {
      for(int j = 0 ; j < path.Branch(i).Count;j++) // polyline branch
      {

        Point3d[] vertices = path.Branch(i)[j].ToArray(); // polyline vertices in an array
        string polylineGcode = ""; // gcodes for a polyline
        string[] parseString = pathInfo.Branch(i)[j].Split(' ');
        double temp = Convert.ToDouble(parseString[0].Split('T')[1]); // temperature for this line
        temp = Math.Round(temp, 1);
        double feedrate = Convert.ToDouble(parseString[1].Split('F')[1]); // speed for this line
        string cType = parseString[2].Split('C')[1]; // speed for this line

        double extrusion = 0;
        double segmentLength = 0;
        bool gradientH = false;

        for(int k = 0 ; k < vertices.Length ; k++) // does not need to iterate to the last point which is identical to the first one
        {
          double currentZ = vertices[k].Z;
          if(k != 0) {segmentLength = vertices[k].DistanceTo(vertices[(k - 1) % vertices.Length]);} // get distance to the next point
          extrusion += extrutionRate(segmentLength, x, h, dN, dF);

          if(k == 0) // when it first starts to print
          {
            if(fan && i == 1 && j == 0) {polylineGcode += "M106 S255\n";} // turn on the fan at 2nd layer

            if(temp != prevTemp)
            {
              polylineGcode += "G1 X300 Y50 F20000 ; go to purging position\n"; // go to station
              if(temp < prevTemp){polylineGcode += "M106 S255\n";} // fan on for fast cooling
              else{polylineGcode += "M106 S0\n";}

              //              if(cType == "H") // this is for gradient
              //              {
              //                temp = gradientStart;
              //                gradientH = true;
              //              }

              polylineGcode += String.Format("M109 R{0} T{1}\n", temp, tool);// set temperature here compare temperature from previous temp

              if(fan){polylineGcode += "M106 S255\n";}
              else {
                polylineGcode += "M106 S0\n"; // fan off for printing
              }

              polylineGcode += "M106 S255\n";
              polylineGcode += "G92 E0\n";
              polylineGcode += "G1 E15 F500\n";// purging material if its the start of the new polyline with different temp
              polylineGcode += "G1 E20 F1500\n";// purging material if its the start of the new polyline with different temp

              polylineGcode += "G4 S5\n";

              polylineGcode += "M98 P\"clean_nozzle.g\"\n"; // go to prime mode, but do not if its the very first layer bc it is a waste of filmanet
              polylineGcode += "G92 E0\n";
              polylineGcode += "G1 E5 F1500\n";
              if(!fan){polylineGcode += "M106 S0\n";}
              //              if(gradientH)
              //              {
              //                prevTemp = gradientEnd;
              //
              //              }
              //              else
              //              {
              //                prevTemp = temp;
              //              }
              prevTemp = temp;
            }
            polylineGcode += "G92 E0\n"; // G92 printing mode
            extrusion = 0;
            if(retraction) {
              polylineGcode += String.Format("G1 E{0} F{1} ;retraction \n", -1 * retractionDistance, retractionSpeed); // retration
              polylineGcode += "G92 E0\n"; // G92 printing mode
              extrusion = 0;
            }
            if(zLift) polylineGcode += String.Format("G1 Z{0} F{1} ; zhop \n", currentZ + zLiftDistance, zLiftSpeed);
            polylineGcode += String.Format("G1 X{0} Y{1} F{2} ; first point of the polyline\n", Math.Round(vertices[k].X, coordRoundDecimal), Math.Round(vertices[k].Y, coordRoundDecimal), travelSpeed);
            if(zLift) polylineGcode += String.Format("G1 Z{0} F{1} ; return to original z height\n", currentZ, zLiftSpeed);
            polylineGcode += "G92 E0\n";
            extrusion = 0;
            //            if(gradientH){
            //              polylineGcode += String.Format("M104 s{0}; gradient temperature\n", 300);// set gradient temperature
            //              // set speed based on the length
            //            }
          }
          else
          {
            // TODO based on temp value change extrusion
            polylineGcode += String.Format("G1 X{0} Y{1} Z{2} E{3} F{4} ;extruding \n", Math.Round(vertices[k].X, coordRoundDecimal), Math.Round(vertices[k].Y, coordRoundDecimal), Math.Round(vertices[k].Z, coordRoundDecimal), Math.Round(extrusion, extrusionRoundDecimal), feedrate);
          }
          endpointZ = currentZ; // get the height of the end point of the current polyline

        }
        polylineGcode += "G92 E0.0000\n";
        extrusion = 0;
        if(retraction) {
          polylineGcode += String.Format("G1 E{0} F{1} ;retraction \n", -1 * retractionDistance, retractionSpeed); // retration
          polylineGcode += "G92 E0\n"; // G92 printing mode
          extrusion = 0;
        }
        if(zLift) polylineGcode += String.Format("G1 Z{0} F{1}\n", endpointZ + zLiftDistance, zLiftSpeed);

        polylineGcode += "; end of polyline \n";
        gCode.Add(polylineGcode); // add gcode for a polyline
      }
      //      polylineGcode += "G1 X300 Y103.5 F20000 ; go to purging station\n";
      gCode.Add(";layer end\n"); // end of the layer
    }
    gCodeBody = gCode;
# ---------- printingpath2gcode: C# additional code ----------
  double extrutionRate(double length, double flowRate, double layerHeight, double NozzleDiameter, double filamentDiameter)
  {
    return (4 * layerHeight * flowRate * length * NozzleDiameter) / (Math.PI * Math.Pow(filamentDiameter, 2));
  }
# ---------- end printingpath2gcode ----------
merge_7 = Merge(Data1=flatten(panel_2), Data2=flatten(printingpath2gcode.gCodeBody), Data3=flatten(panel_3))  # -> flatten(Result)

c_script_3 = CSharpScript(printingPath=flatten(sortpath2data.sortedpath_2), tempVal=flatten(sortpath2data.sortedtemp_2))  # -> out, curve, color; inputs printingPath: list of Polyline, tempVal: list of Double
# ---------- c_script_3: C# ----------
    color = GetHeatmapColors(tempVal, 190, 300);
    curve = printingPath;
# ---------- c_script_3: C# additional code ----------
  public static List<Color> GetHeatmapColors(List<double> values, int minValue, int maxValue)
  {
    List<Color> heatmapColors = new List<Color>();

    foreach (int value in values)
    {
      double normalizedValue = (double) (value - minValue) / (maxValue - minValue); // Normalize the value between 0 and 1

      // Define the heat map colors
      Color colorMin = Color.White;
      Color colorMax = Color.Red;

      // Interpolate between the minimum and maximum colors based on the normalized value
      int r = (int) (colorMin.R + (colorMax.R - colorMin.R) * normalizedValue);
      int g = (int) (colorMin.G + (colorMax.G - colorMin.G) * normalizedValue);
      int b = (int) (colorMin.B + (colorMax.B - colorMin.B) * normalizedValue);

      // Clamp the red value within the valid range (0-255)
      if (r < 0)
        r = 0;
      else if (r > 255)
        r = 255;

      // Clamp the green value within the valid range (0-255)
      if (g < 0)
        g = 0;
      else if (g > 255)
        g = 255;

      // Clamp the blue value within the valid range (0-255)
      if (b < 0)
        b = 0;
      else if (b > 255)
        b = 255;

      heatmapColors.Add(Color.FromArgb(r, g, b));
    }

    return heatmapColors;
  }
# ---------- end c_script_3 ----------
sphere = Sphere(Base=PlaneXY(0, 0, 0), Radius=0.5)
custom_preview_5 = CustomPreview(Geometry=sphere, Material=ColourSwatch(SwatchColor=RGBA(0, 255, 255, 163)))
custom_preview_6 = CustomPreview(Geometry=c_script_3.curve, Material=c_script_3.color)

colour_swatch_12 = ColourSwatch(SwatchColor=RGB(57, 60, 255))
custom_preview_7 = CustomPreview(Geometry=getinnerwall.innerwalls, Material=ColourSwatch(SwatchColor=RGBA(0, 246, 255, 57)))
custom_preview_8 = CustomPreview(Geometry=getinfill.result, Material=colour_swatch_12)

panel_8 = Panel(merge_7)

droid_save_gcode = DroidSaveGcode(Save=value_listener_3.Values, Gcode=panel_8)

custom_preview_9 = CustomPreview(Geometry=getinfill.top, Material=colour_swatch_12)
object_bake = ObjectBake(
    BakeToggle=Button(),
    GeometryObjects=c_script_3.curve,
    Layer="GH_Bake",
    ObjectName="GH_Obj",
    ObjectColor=c_script_3.color,
    LayerColor=RGB(255, 255, 255))

# ==== cluster MapColor2Temp
grayscale = ClusterInput()
grayscale_2 = Number(grayscale)
bounds = Bounds(Numbers=grayscale_2)
maxtemp = ClusterInput()
mintemp = ClusterInput()
deconstruct_domain = DeconstructDomain(Domain=bounds)  # -> Start, End
maxtemp_2 = Number(maxtemp)
mintemp_2 = Number(mintemp)
construct_domain = ConstructDomain(DomainStart=deconstruct_domain.Start, DomainEnd=deconstruct_domain.End)
construct_domain_2 = ConstructDomain(DomainStart=mintemp_2, DomainEnd=maxtemp_2)
panel = Panel(construct_domain)
remap_numbers = RemapNumbers(Value=grayscale_2, Source=construct_domain, Target=construct_domain_2)  # -> Mapped, Clipped
mapped = ClusterOutput(remap_numbers.Mapped)
maxtemp_3 = ClusterOutput(maxtemp_2)
mintemp_3 = ClusterOutput(mintemp_2)
panel_2 = Panel(remap_numbers.Mapped)

# ==== cluster GetInnerWall
brep = ClusterInput()
cap_holes = CapHoles(Brep=brep)
distance = ClusterInput()
linegapmultiplier = ClusterInput()
brep_2 = Brep(cap_holes)
mesh_brep = MeshBrep(
    Brep=brep_2,
    Settings={GridMaxCount=0, GridMinCount=16, JaggedSeams=False, MaxEdgeLength=0, MinEdgeLength=0.0001, MinTolerance=0, Refine=True, RefineAngle=0, RelativeTolerance=0.65, SimplePlanes=True, Tolerance=0})
linegapmultiplier_2 = Number(linegapmultiplier)
contour = Contour(Shape=brep_2, Point=Point(0, 0, 0), Direction=Vector(0, 0, 1), Distance=distance)  # -> simplify(Contours)
offset_mesh = OffsetMesh(Mesh=mesh_brep, Distance=expr("x*0.8*(-1)", linegapmultiplier_2), BothSides=False, CreateSolid=False)
tree_branch = TreeBranch(Tree=contour, Path="{1}", MaintainPaths=True)
tree_branch_2 = TreeBranch(Tree=contour, Path="{2}", MaintainPaths=True)
unit_z = UnitZ(Factor=1)
contour_2 = Contour(Shape=offset_mesh, Point=Point(0, 0, 0), Direction=unit_z, Distance=distance)  # -> simplify(flatten(Contours))
close_curve = CloseCurve(Curve=tree_branch, CloseType=0, Bulge=0.5, Tolerance=0)  # -> flatten(Closed), ResultBoolean
close_curve_2 = CloseCurve(Curve=tree_branch_2, CloseType=0, Bulge=0.5, Tolerance=0)  # -> flatten(Closed), ResultBoolean
close_curve_3 = CloseCurve(Curve=contour_2, CloseType=0, Bulge=0.5, Tolerance=0)  # -> Closed, ResultBoolean
series = Series(Start=1, Step=1, Count=Slider(2, range=0..10))
number = Number(expr("x*0.8*(-1)", linegapmultiplier_2))
area = Area(Geometry=close_curve_3.Closed)  # -> Area, Centroid
multiplication = Multiplication(A=number, B=series)
smaller_than = SmallerThan(FirstNumber=area.Area, SecondNumber=Slider(5, range=0..10))  # -> SmallerThan, OrEqualTo
offset_curve = OffsetCurve(Curve=close_curve.Closed, Distance=multiplication, Corners=1)  # -> simplify(flatten(Curve))
offset_curve_2 = OffsetCurve(Curve=close_curve_2.Closed, Distance=multiplication, Corners=1)  # -> simplify(flatten(Curve))
dispatch = Dispatch(List=close_curve_3.Closed, DispatchPattern=smaller_than.OrEqualTo)  # -> ListA, flatten(ListB)
area_2 = Area(Geometry=dispatch.ListB)  # -> Area, Centroid
deconstruct = Deconstruct(Point=area_2.Centroid)  # -> XComponent, YComponent, ZComponent
curve = Curve(dispatch.ListB)
sort_list = SortList(Keys=deconstruct.ZComponent, ValuesValuesA=dispatch.ListB)  # -> Keys, ValuesValuesA
smaller_than_2 = SmallerThan(FirstNumber=sort_list.Keys, SecondNumber=distance)  # -> SmallerThan, OrEqualTo
dispatch_2 = Dispatch(List=sort_list.ValuesValuesA, DispatchPattern=smaller_than_2.OrEqualTo)  # -> ListA, ListB

# ----
# getZ
end = EndPoints(Curve=flatten(dispatch_2.ListB))  # -> Start, End
pdecon = Deconstruct(Point=end.Start)  # -> XComponent, YComponent, ZComponent

sort = SortList(Keys=flatten(pdecon.ZComponent), ValuesA=flatten(dispatch_2.ListB))  # -> Keys, ValuesA
path_mapper = PathMapper(offset_curve_2, source="{A}", target="{A+1}")
sortlline_z = CSharpScript(pathCrv=flatten(sort.ValuesA), pathZ=flatten(sort.Keys))  # -> out, sortedPath; inputs pathCrv: list of Polyline, pathZ: list of Double
# ---------- sortlline_z: C# ----------
    double prevZ = -100;
    int layerCount = -1; // start with negative -1 so that the first layer is 0
    DataTree<Polyline> pathTree = new DataTree<Polyline>();

    for(int i = 0 ; i < pathCrv.Count; i++)
    {
      if( Math.Round(pathZ[i], 1) != Math.Round(prevZ, 1))
      {
        Print(pathZ[i].ToString());
        prevZ = pathZ[i];
        layerCount++;
      }
      GH_Path layerPath = new GH_Path(layerCount);

      pathTree.Add(pathCrv[i], layerPath);

    }
    Print(layerCount.ToString());
    sortedPath = pathTree;
# ---------- sortlline_z: C# additional code ----------
  /// <summary>
  /// This method will be called once every solution, before any calls to RunScript.
  /// </summary>
  public override void BeforeRunScript()
  { }
  /// <summary>
  /// This method will be called once every solution, after any calls to RunScript.
  /// </summary>
  public override void AfterRunScript()
  { }
# ---------- end sortlline_z ----------
removetreebranch = RemoveTreeBranch(T=sortlline_z.sortedPath, i=0)
path_mapper_2 = PathMapper(removetreebranch, source="{A}", target="{A+2}")
merge = Merge(Data1=simplify(offset_curve), Data2=simplify(path_mapper), Data3=path_mapper_2)
list_item = ListItem(List=offset_curve, Index=-1, Wrap=True)
list_item_2 = ListItem(List=offset_curve_2, Index=-1, Wrap=True)
path_mapper_3 = PathMapper(list_item_2, source="{A}", target="{A+1}")
tree_branch_3 = TreeBranch(Tree=merge, Path=Slider(1, range=0..10), MaintainPaths=True)
merge_2 = Merge(Data1=simplify(list_item), Data2=simplify(path_mapper_3), Data3=path_mapper_2)
param_viewer = ParamViewer(merge_2)
# for Gcode
innerwalls = ClusterOutput(merge)
# for infill
infill_ref = ClusterOutput(merge_2)

# ==== cluster GetInfill
linegapmultiplier = ClusterInput()
geo = ClusterInput()
pathdata = ClusterInput()
linegapmultiplier_2 = Number(linegapmultiplier)
geo_2 = Brep(geo)
list_item = ListItem(List=geo_2, Index=0, Wrap=True)
list_item_2 = ListItem(List=geo_2, Index=1, Wrap=True)
curve = Curve(pathdata)
distnace = ClusterInput()
number = Number(expr("(0.8*x*(1)-0.1)/0.4", linegapmultiplier_2))
gradientangle = ClusterInput()
tstat = TreeStatistics(Tree=curve)  # -> Paths, Length, Count
round = Round(Number=number)  # -> Nearest, Floor, Ceiling
infill = Infill(linegap=expr("0.8*x*(-1)", linegapmultiplier_2), data=pathdata, brep=geo_2, distance=distnace)

# ----
# top crv
subtraction = Subtraction(A=tstat.Count, B=1)
tree_branch = TreeBranch(Tree=curve, Path=subtraction, MaintainPaths=True)

radians = Radians(Degrees=gradientangle)
series = Series(Start=0.4, Step=0.4, Count=round.Floor)
curve_middle = CurveMiddle(Curve=infill)
rotate = Rotate(Vector="{0,1,0}", Axis="{0,0,1}", Angle=radians)
unit_z = UnitZ(Factor=series)
move = Move(Geometry=tree_branch, Motion=unit_z)  # -> simplify(flatten(Geometry)), Transform
panel = Panel("""{1,0,0}
{0,1,0}""")
scale = Scale(Geometry=infill, Center=curve_middle, Factor=Slider(0.95, range=0..1))  # -> Geometry, Transform
boundary_surfaces = BoundarySurfaces(Edges=move.Geometry)
merge = Merge(Data1="{1,0,0}", Data2=rotate)  # -> flatten(Result)
contour = Contour(Shape=boundary_surfaces, Point=Point(0, 0, 0), Direction=merge, Distance=expr("0.8*x", linegapmultiplier_2))
panel_2 = Panel(merge)
trim_tree = TrimTree(Tree=contour, Depth=1)
curve_middle_2 = CurveMiddle(Curve=trim_tree)
scale_2 = Scale(Geometry=trim_tree, Center=curve_middle_2, Factor=Slider(0.95, range=0..1))  # -> Geometry, Transform
explode_tree = ExplodeTree(Data=scale_2.Geometry)  # -> Branch0, Branch1

merge_2 = Merge(Data1=simplify(graft(move.Geometry)), Data2=explode_tree.Branch0)
tree_statistics = TreeStatistics(Tree=scale.Geometry)  # -> Paths, Length, Count
tree_statistics_2 = TreeStatistics(Tree=merge_2)  # -> Paths, Length, Count
addition = Addition(A=tree_statistics.Count, B=1)
merge_3 = Merge(Data1=tree_statistics.Count, Data2=addition)
replace_paths = ReplacePaths(Data=merge_2, Search=tree_statistics_2.Paths, Replace=merge_3)

length = Length(Curve=explode_tree.Branch1)
smaller_than = SmallerThan(FirstNumber=length, SecondNumber=1)  # -> SmallerThan, OrEqualTo
dispatch = Dispatch(List=explode_tree.Branch1, DispatchPattern=smaller_than.SmallerThan)  # -> ListA, ListB
merge_4 = Merge(Data1=scale.Geometry)
number_slider = Slider(0.4, range=0..1)
curve_2 = Curve(dispatch.ListB)

list_item_3 = ListItem(List=curve_2, Index=0, Wrap=True)
end_points = EndPoints(Curve=list_item_3)  # -> Start, End
deconstruct = Deconstruct(Point=end_points.Start)  # -> XComponent, YComponent, ZComponent

tree_statistics_3 = TreeStatistics(Tree=merge_4)  # -> Paths, Length, Count
list_length = ListLength(List=tree_statistics_3.Paths)
multiplication = Multiplication(A=number_slider, B=list_length)
addition_2 = Addition(A=multiplication, B=number_slider)
subtraction_2 = Subtraction(A=deconstruct.ZComponent, B=addition_2)
unit_z_2 = UnitZ(Factor=expr("-x", subtraction_2))
move_2 = Move(Geometry=curve_2, Motion=unit_z_2)  # -> Geometry, Transform
result = ClusterOutput(merge_4)
top = ClusterOutput(move_2.Geometry)

# ==== cluster GetColorFromBrep
colordata = ClusterInput()
brep = ClusterInput()
brep_2 = Brep(brep)
colordata_2 = Data(colordata)
tree_statistics = TreeStatistics(Tree=brep_2)  # -> Paths, Length, Count
tree_statistics_2 = TreeStatistics(Tree=colordata_2)  # -> Paths, Length, Count
object_details = ObjectDetails(Object=brep_2)  # -> Referenced, Available, Name, Layer, Colour, Guid
deconstruct_path = DeconstructPath(Branch=tree_statistics.Paths)
deconstruct_path_2 = DeconstructPath(Branch=tree_statistics_2.Paths)
panel = Panel("""a
b
c
d""")
panel_2 = Panel("""6
4
3
2""")
tree_branch = TreeBranch(Tree=colordata_2, Path=deconstruct_path_2, MaintainPaths=False)
tree_branch_2 = TreeBranch(Tree=brep_2, Path=deconstruct_path, MaintainPaths=False)
greyscale = CSharpScript(c=tree_branch)  # -> out, grayscaled, colorData; inputs c: list of Color
# ---------- greyscale: C# usings ----------
using System.Drawing;
# ---------- greyscale: C# ----------
    List<double> color = new List<double>();
    List<string> colorType = new List<string>();
    // color type H: horizontal, V: vertical, S: solid
    for(int i = 0 ; i < c.Count;i++)
    {
      Int32 r = c[i].R;
      Int32 g = c[i].G;
      Int32 b = c[i].B;
      double grayscale = 0.299 * r + 0.587 * g + 0.114 * b;
      string cType = "";
      if(c[i].A > 200)
      {
        cType = "S1";
      }
      else if(c[i].A > 150 )
      {
        cType = "V1";
      }
      else if(c[i].A > 100 )
      {
        cType = "V0";
      }
      else if(c[i].A > 50 )
      {
        cType = "H1";
      }
      else if(c[i].A > 0 )
      {
        cType = "H0";
      }

      colorType.Add(cType);
      color.Add(grayscale);
    }
    colorData = colorType;
    grayscaled = color;
# ---------- end greyscale ----------
list_length = ListLength(List=tree_branch_2)  # -> flatten(Length)
panel_3 = Panel(greyscale.colorData)
duplicate_data = DuplicateData(Data=simplify(greyscale.colorData), Number=simplify(graft(list_length)), Order=True)  # -> simplify(Data)
sort_list = SortList(Keys=greyscale.grayscaled, ValuesValuesA=brep_2)  # -> Keys, ValuesValuesA
sort_list_2 = SortList(Keys=greyscale.grayscaled, ValuesValuesA=greyscale.colorData)  # -> Keys, ValuesValuesA
duplicate_data_2 = DuplicateData(Data=simplify(greyscale.grayscaled), Number=simplify(graft(list_length)), Order=True)  # -> simplify(Data)
colorlistlength = CSharpScript(grayscale=sort_list.Keys)  # -> out, partition; inputs grayscale: list of Double
# ---------- colorlistlength: C# ----------
    List<int> counterList = new List<int>();
    //    List<int> colorList = new List<int>();

    double prevColor = grayscale[0];
    int counter = 1;
    //    colorList.Add((int) grayscale[0]);
    for(int i = 1 ; i < grayscale.Count;i++)
    {
      if(grayscale[i] == prevColor)
      {
        counter++;
      }
      else
      {

        counterList.Add(counter);
        counter = 1;
        //        colorList.Add((int) grayscale[i]);
        prevColor = grayscale[i];
      }
    }
    counterList.Add(counter);
    //    new_grayscale = colorList;
    partition = counterList;
# ---------- end colorlistlength ----------
partition = PartitionList(List=sort_list.ValuesValuesA, Size=colorlistlength.partition)  # -> simplify(Chunks)
geo = Brep(flatten(tree_branch_2))

# ----
# grayscaled value
color = Number(flatten(duplicate_data_2))

data = Data(flatten(duplicate_data))
data_2 = ClusterOutput(data)
geo_2 = ClusterOutput(geo)
color_2 = ClusterOutput(color)

# ==== cluster GetContour
layer_height = ClusterInput()
layer_height_2 = Number(layer_height)
shape = ClusterInput()
unit_z = UnitZ(Factor=1)
contour = Contour(Shape=simplify(flatten(shape)), Point=Point(0, 0, 0), Direction=unit_z, Distance=layer_height_2)  # -> simplify(Contours)
trim = TrimTree(Tree=contour, Depth=1)
curve_to_polyline = CurveToPolyline(Curve=trim, ToleranceDistance=0.1, ToleranceAngle=0)  # -> Polyline, Segments
panel = Panel(curve_to_polyline.Polyline)
polyline = ClusterOutput(curve_to_polyline.Polyline)

# ==== cluster SortPath2Data
pathcrv = ClusterInput()
pathdata = ClusterInput()
tempdata = ClusterInput()
pathcrv_2 = Curve(pathcrv)
pathdata_2 = Data(pathdata)
tempdata_2 = Data(tempdata)

# ----
# getZ
end = EndPoints(Curve=flatten(pathcrv_2))  # -> Start, End
pdecon = Deconstruct(Point=end.Start)  # -> XComponent, YComponent, ZComponent

sort = SortList(Keys=flatten(pdecon.ZComponent), ValuesA=flatten(tempdata_2))  # -> Keys, ValuesA
sort_2 = SortList(Keys=flatten(pdecon.ZComponent), ValuesA=flatten(pathdata_2))  # -> Keys, ValuesA
sort_3 = SortList(Keys=flatten(pdecon.ZComponent), ValuesA=flatten(pathcrv_2))  # -> Keys, ValuesA
sortouterline_z = CSharpScript(pathCrv=flatten(sort_3.ValuesA), pathZ=flatten(sort_3.Keys), data=flatten(sort_2.ValuesA), temp=flatten(sort.ValuesA))  # -> out, sortedPath, sortedData, sortedTemp; inputs pathCrv: list of Polyline, pathZ: list of Double, data: list of String, temp: list of Int32
# ---------- sortouterline_z: C# ----------
    double prevZ = -100;
    int layerCount = -1; // start with negative -1 so that the first layer is 0
    DataTree<Polyline> pathTree = new DataTree<Polyline>();
    DataTree<string> pathData = new DataTree<string>();
    DataTree<int> tempTree = new DataTree<int>();

    for(int i = 0 ; i < pathCrv.Count; i++)
    {
      if( Math.Round(pathZ[i], 1) != Math.Round(prevZ, 1))
      {
        prevZ = pathZ[i];
        layerCount++;
      }

      GH_Path layerPath = new GH_Path(layerCount);
      pathTree.Add(pathCrv[i], layerPath);
      pathData.Add(data[i], layerPath);
      tempTree.Add(temp[i], layerPath);

    }
    sortedTemp = tempTree;
    sortedData = pathData;
    sortedPath = pathTree;
# ---------- end sortouterline_z ----------
sort_list = SortList(Keys=sortouterline_z.sortedTemp, ValuesValuesA=sortouterline_z.sortedData)  # -> Keys, ValuesValuesA
sort_list_2 = SortList(Keys=sortouterline_z.sortedTemp, ValuesValuesA=sortouterline_z.sortedPath)  # -> Keys, ValuesValuesA
panel = Panel(sort_list_2.ValuesValuesA)
removetreebranch = RemoveTreeBranch(T=sort_list_2.ValuesValuesA, i=0)
removetreebranch_2 = RemoveTreeBranch(T=sort_list.Keys, i=0)
removetreebranch_3 = RemoveTreeBranch(T=sort_list.ValuesValuesA, i=0)
sortedpath = Data(removetreebranch)
sortedtemp = Data(removetreebranch_2)
sorteddata = Data(removetreebranch_3)
sortedpath_2 = ClusterOutput(sortedpath)
sortedtemp_2 = ClusterOutput(sortedtemp)
sorteddata_2 = ClusterOutput(sorteddata)

# ==== cluster Cluster
data = ClusterInput()
data_2 = Data(data)
tree_statistics = TreeStatistics(Tree=data_2)  # -> Paths, Length, Count
deconstruct_path = DeconstructPath(Branch=tree_statistics.Paths)  # -> flatten(Indices)
contains = CSharpScript(colorPathAddress=deconstruct_path, gradientAddress="19")  # -> out, pattern; inputs colorPathAddress: list of Int32, gradientAddress: Int32
# ---------- contains: C# ----------
    int pathCount = colorPathAddress.Count;
    int[] pathIndex = new int[pathCount];
    for(int i = 0 ; i < pathCount; i++)
    {

      if(colorPathAddress[i] == gradientAddress)
      {
        pattern = gradientAddress;
      }


    }

    //    pattern = pathIndex;
# ---------- end contains ----------
contains_2 = CSharpScript(colorPathAddress=deconstruct_path, gradientAddress="18")  # -> out, pattern; inputs colorPathAddress: list of Int32, gradientAddress: Int32; same code as contains
contains_3 = CSharpScript(colorPathAddress=deconstruct_path, gradientAddress="17")  # -> out, pattern; inputs colorPathAddress: list of Int32, gradientAddress: Int32
# ---------- contains_3: C# ----------
    int pathCount = colorPathAddress.Count;
    int[] pathIndex = new int[pathCount];
    for(int i = 0 ; i < pathCount; i++)
    {

      if(colorPathAddress[i] == gradientAddress)
      {
        pattern = gradientAddress;
      }

    }

    //    pattern = pathIndex;
# ---------- end contains_3 ----------
contains_4 = CSharpScript(colorPathAddress=deconstruct_path, gradientAddress="16")  # -> out, pattern; inputs colorPathAddress: list of Int32, gradientAddress: Int32; same code as contains_3
construct_path = ConstructPath(Indices=graft(contains_3.pattern))  # -> flatten(BranchA)
construct_path_2 = ConstructPath(Indices=graft(contains_4.pattern))  # -> flatten(BranchA)
construct_path_3 = ConstructPath(Indices=graft(contains_2.pattern))  # -> flatten(BranchA)
construct_path_4 = ConstructPath(Indices=graft(contains.pattern))  # -> flatten(BranchA)
tree_branch = TreeBranch(Tree=data_2, Path=construct_path, MaintainPaths=True)
tree_branch_2 = TreeBranch(Tree=data_2, Path=construct_path_2, MaintainPaths=True)
tree_branch_3 = TreeBranch(Tree=data_2, Path=construct_path_3, MaintainPaths=True)
tree_branch_4 = TreeBranch(Tree=data_2, Path=construct_path_4, MaintainPaths=True)
number = ClusterInput()
number_2 = ClusterInput()
number_3 = Number(number)
number_4 = Number(number_2)
unit_z = UnitZ(Factor=1)
contour = Contour(Shape=tree_branch_2, Point=Point(0, 0, 0), Direction=unit_z, Distance=number_3)
unit_z_2 = UnitZ(Factor=1)
contour_2 = Contour(Shape=tree_branch, Point=Point(0, 0, 0), Direction=unit_z_2, Distance=number_3)
unit_z_3 = UnitZ(Factor=1)
contour_3 = Contour(Shape=tree_branch_3, Point=Point(0, 0, 0), Direction=unit_z_3, Distance=number_3)
unit_z_4 = UnitZ(Factor=1)
contour_4 = Contour(Shape=tree_branch_4, Point=Point(0, 0, 0), Direction=unit_z_4, Distance=number_3)
end_points = EndPoints(Curve=flatten(contour_3))  # -> Start, End
end_points_2 = EndPoints(Curve=flatten(contour_4))  # -> Start, End
divide_curve = DivideCurve(Curve=contour, Count=number_4, Kinks=False)  # -> simplify(Points), Tangents, Parameters
divide_curve_2 = DivideCurve(Curve=contour_2, Count=number_4, Kinks=False)  # -> simplify(Points), Tangents, Parameters
contours = ClusterOutput(contour_3)
deconstruct = Deconstruct(Point=end_points.Start)  # -> XComponent, YComponent, ZComponent
bounds = Bounds(Numbers=deconstruct.ZComponent)
contours_2 = ClusterOutput(contour_4)
deconstruct_2 = Deconstruct(Point=end_points_2.Start)  # -> XComponent, YComponent, ZComponent
bounds_2 = Bounds(Numbers=deconstruct_2.ZComponent)
deconstruct_domain = DeconstructDomain(Domain=bounds)  # -> Start, End
deconstruct_domain_2 = DeconstructDomain(Domain=bounds_2)  # -> Start, End
shatter = Shatter(Curve=contour, Parameters=divide_curve.Parameters)  # -> simplify(Segments)
shatter_2 = Shatter(Curve=contour_2, Parameters=divide_curve_2.Parameters)  # -> simplify(Segments)
gradient = Gradient(
    LowerLimit=deconstruct_domain.Start,
    UpperLimit=deconstruct_domain.End,
    Parameter=deconstruct.ZComponent,
    stops=[0: RGB(241, 177, 96), 1: RGB(64, 47, 0)])
gradient_2 = Gradient(
    LowerLimit=deconstruct_domain_2.Start,
    UpperLimit=deconstruct_domain_2.End,
    Parameter=deconstruct_2.ZComponent,
    stops=[0: RGB(241, 177, 96), 1: RGB(64, 47, 0)])
segments = ClusterOutput(shatter)
segments_2 = ClusterOutput(shatter_2)
list_length = ListLength(List=shatter)
list_length_2 = ListLength(List=shatter_2)
colour = ClusterOutput(gradient)
colour_2 = ClusterOutput(gradient_2)
series = Series(Start=0, Step=1, Count=list_length)
series_2 = Series(Start=0, Step=1, Count=list_length_2)
gradient_3 = Gradient(LowerLimit=graft("0"), UpperLimit=list_length, Parameter=series, stops=[0: RGB(241, 177, 96), 1: RGB(64, 47, 0)])
gradient_4 = Gradient(LowerLimit=graft("0"), UpperLimit=list_length_2, Parameter=series_2, stops=[0: RGB(241, 177, 96), 1: RGB(64, 47, 0)])
colour_3 = ClusterOutput(gradient_3)
colour_4 = ClusterOutput(gradient_4)

# ==== cluster RemoveTreeBranch
T = ClusterInput()
i = ClusterInput()
T_2 = Data(T)
i_2 = Number(expr("x+1", i))
tstat = TreeStatistics(Tree=T_2)  # -> Paths, Length, Count
series = Series(Start=i_2, Step=1, Count=expr("x-1", tstat.Count))  # -> simplify(flatten(Series))
branch = TreeBranch(Tree=T_2, Path=series, MaintainPaths=False)
T_3 = Data(branch)
T_4 = ClusterOutput(T_3)

# ==== cluster Infill
brep = ClusterInput()
data = ClusterInput()
brep_2 = Brep(brep)
data_2 = Data(data)

# ----
# getZ
end = EndPoints(Curve=flatten(data_2))  # -> Start, End
pdecon = Deconstruct(Point=end.Start)  # -> XComponent, YComponent, ZComponent

sort = SortList(Keys=flatten(pdecon.ZComponent), ValuesA=flatten(data_2))  # -> Keys, ValuesA
linegap = ClusterInput()
distance = ClusterInput()
linegap_2 = Number(linegap)
sortinfillline_z = CSharpScript(pathCrv=flatten(sort.ValuesA), pathZ=flatten(sort.Keys))  # -> out, sortedPath; inputs pathCrv: list of Polyline, pathZ: list of Double; same code as sortlline_z
distance_2 = Number(distance)

bbox = BoundingBox(Content=brep_2, Plane=PlaneXY(0, 0, 0))  # -> Box, Box_2
debrep = DeconstructBrep(Brep=bbox.Box)  # -> Faces, Edges, Vertices
item = ListItem(List=debrep.Faces, Index="4", Wrap=True)
xline = ListItem(List=debrep.Edges, Index=0, Wrap=True)
yline = ListItem(List=debrep.Edges, Index=1, Wrap=True)
len = Length(Curve=xline)
len_2 = Length(Curve=yline)
division = Division(A=len, Distance=distance_2)
division_2 = Division(A=len_2, Distance=distance_2)
sdivide = DivideSurface(Surface=item, UCount=division, VCount=division_2)  # -> simplify(Points), Normals, Parameters

data_3 = Data(sortinfillline_z.sortedPath)
tstat = TreeStatistics(Tree=data_3)  # -> Paths, Length, Count
# remove top crv
removetreebranch = RemoveTreeBranch_2(T=data_3, i=expr("x-1", tstat.Count))

# ----
# top crv
subtraction = Subtraction(A=tstat.Count, B=1)
tree_branch = TreeBranch(Tree=data_3, Path=subtraction, MaintainPaths=True)

data_4 = Data(data_3)

item_2 = ListItem(List=debrep.Edges, Index="8", Wrap=True)
len_3 = Length(Curve=item_2)
Z = UnitZ(Factor=len_3)

pipe = Pipe(Curve=data_3, Radius=0.1, Caps=flatten(0))
boundary_surfaces = BoundarySurfaces(Edges=tree_branch)

# ----
# sort even and odd layers
tstat_2 = TreeStatistics(Tree=data_4)  # -> Paths, Length, Count
division_3 = Division(A=tstat_2.Count, B=2)
division_4 = Division(A=tstat_2.Count, B=2)
round = Round(Number=division_4)  # -> Nearest, Floor, Ceiling
round_2 = Round(Number=division_3)  # -> Nearest, Floor, Ceiling
series = Series(Start=0, Step=2, Count=round.Ceiling)
series_2 = Series(Start=1, Step=2, Count=round_2.Floor)
branch = TreeBranch(Tree=data_4, Path=series, MaintainPaths=True)
branch_2 = TreeBranch(Tree=data_4, Path=series_2, MaintainPaths=True)

flip = FlipMatrix(Data=sdivide.Points)
item_3 = ListItem(List=flip, Index=-1, Wrap=True)
item_4 = ListItem(List=flip, Index=0, Wrap=True)
item_5 = ListItem(List=sdivide.Points, Index=-1, Wrap=True)
item_6 = ListItem(List=sdivide.Points, Index=0, Wrap=True)
ln = Line(StartPoint=item_4, EndPoint=item_3)
ln_2 = Line(StartPoint=item_6, EndPoint=item_5)

unit_x = UnitX(Factor=1)
contour = Contour(Shape=boundary_surfaces, Point=Point(0, 0, 0), Direction=unit_x, Distance=linegap_2)  # -> flatten(Contours)
panel = Panel(contour)
extr = Extrude(Base=ln, Direction=Z)
extr_2 = Extrude(Base=ln_2, Direction=Z)
boundary_surfaces_2 = BoundarySurfaces(Edges=branch)
boundary_surfaces_3 = BoundarySurfaces(Edges=branch_2)
# intersect
bbx = BrepBrep(BrepA=flatten(boundary_surfaces_2), BrepB=graft(extr))  # -> simplify(Curves), Points
bbx_2 = BrepBrep(BrepA=flatten(boundary_surfaces_3), BrepB=graft(extr_2))  # -> simplify(Curves), Points
clean = CleanTree(RemoveNulls=True, RemoveInvalid=True, RemoveEmpty=True, Tree=bbx.Curves)
clean_2 = CleanTree(RemoveNulls=True, RemoveInvalid=True, RemoveEmpty=True, Tree=bbx_2.Curves)
merge = Merge(Data1=clean, Data2=clean_2)  # -> flatten(InfillLines)
smaller_than = SmallerThan(FirstNumber=flatten(merge), SecondNumber=Slider(2, range=0..10))  # -> SmallerThan, OrEqualTo
dispatch = Dispatch(List=merge, DispatchPattern=smaller_than.OrEqualTo)  # -> ListA, ListB
curve = Curve(dispatch.ListB)

# ----
# getZ
end_2 = EndPoints(Curve=flatten(curve))  # -> Start, End
pdecon_2 = Deconstruct(Point=end_2.Start)  # -> XComponent, YComponent, ZComponent

sort_2 = SortList(Keys=flatten(pdecon_2.ZComponent), ValuesA=flatten(curve))  # -> Keys, ValuesA
sortinfillline_z_2 = CSharpScript(pathCrv=flatten(sort_2.ValuesA), pathZ=flatten(sort_2.Keys))  # -> out, sortedPath; inputs pathCrv: list of Polyline, pathZ: list of Double; same code as sortlline_z
tree_statistics = TreeStatistics(Tree=sortinfillline_z_2.sortedPath)  # -> Paths, Length, Count
construct_path = ConstructPath(Indices=tree_statistics.Count)
replace_paths = ReplacePaths(Data=contour, Search="{0}", Replace=construct_path)
param_viewer = ParamViewer()
sortedpath = ClusterOutput(sortinfillline_z_2.sortedPath)

# ==== cluster RemoveTreeBranch_2
T = ClusterInput()
i = ClusterInput()
T_2 = Data(T)
tstat = TreeStatistics(Tree=T_2)  # -> Paths, Length, Count
i_2 = Number(i)
series = Series(Start=i_2, Step=1, Count=expr("x-1", tstat.Count))  # -> simplify(flatten(Series))
series_2 = Series(Start=0, Step=1, Count=tstat.Count)  # -> simplify(flatten(Series))
cull_index = CullIndex(List=series_2, Indices=i_2, Wrap=True)  # -> flatten(List)
branch = TreeBranch(Tree=T_2, Path=cull_index, MaintainPaths=False)
panel = Panel(cull_index)
T_3 = Data(branch)
T_4 = ClusterOutput(T_3)
